# Dynamo graph 不规则圆.dyn (Dynamo 2.0.3.8810)

# group: 笛卡尔形成多个point
code_block = CodeBlock { 1..50..5; }

byCoordinates = Point.ByCoordinates(x=code_block, y=code_block)
# note: 给出点集合列表
number_slider = DoubleSlider(9.2, range=0..100 step 0.1)
number_slider_2 = DoubleSlider(20.4, range=0..100 step 0.1)
byCoordinates_2 = Point.ByCoordinates(x=number_slider, y=number_slider_2)

# group: 点到点的距离
distanceTo = Geometry.DistanceTo(geometry=byCoordinates, other=byCoordinates_2)

number_slider_3 = DoubleSlider(5.9, range=0..100 step 0.1)

# group: 码组；生成不规则圆形
code_block_2 = CodeBlock(x=distanceTo, y=number_slider_3) { x/y; }

# group: 生成圆，确定中心点确定半径
byCenterPointRadius = Circle.ByCenterPointRadius(centerPoint=byCoordinates, radius=code_block_2)

# group: watch3D查看
watch_3d = Watch3D(byCenterPointRadius)
