# Dynamo graph 圆柱练习.dyn (Dynamo 2.0.0.4654)

code_block = CodeBlock { 12; }
byCoordinates = Point.ByCoordinates(z=code_block)
code_block_2 = CodeBlock { 2; }
byPointsRadius = Cylinder.ByPointsRadius(endPoint=byCoordinates, radius=code_block_2)

# group: 复制多个圆柱
code_block_3 = CodeBlock { 0; 50; 4; }
range = Range(start=code_block_3.out0, end=code_block_3.out1, step=code_block_3.out2)
translate = Geometry.Translate(geometry=byPointsRadius, xTranslation=range, yTranslation=range, lacing=CrossProduct)

# group: 色彩创建
code_block_4 = CodeBlock { 255; }
code_block_5 = CodeBlock { 72; }
code_block_6 = CodeBlock { 73; }
byARGB = Color.ByARGB(r=code_block_4, g=code_block_5, b=code_block_6)
code_block_7 = CodeBlock { color=Color.ByARGB(255,177,105,90); }
code_block_8 = CodeBlock { color=Color.ByARGB(255,219,152,100); }
create = List.Create(item0=byARGB, item1=code_block_7, item2=code_block_8)
code_block_9 = CodeBlock { 0.1; 0.2; 0.4; }
create_2 = List.Create(item0=code_block_9.out0, item1=code_block_9.out1, item2=code_block_9.out2)
color_range = ColorRange(colors=create, indices=create_2, value=create_2)

# note: 给几何图上色
byGeometryColor = Modifiers.GeometryColor.ByGeometryColor(geometry=translate, color=color_range, lacing=CrossProduct)
