# Dynamo graph 彩色圆.dyn (Dynamo 2.0.3.8810)

code_block = CodeBlock { 0..50..3; }
byCoordinates = Point.ByCoordinates(x=code_block, y=code_block, lacing=CrossProduct)
byCenterPointRadius = Circle.ByCenterPointRadius(centerPoint=byCoordinates, lacing=CrossProduct)
byPatch = Surface.ByPatch(closedCurve=byCenterPointRadius)
code_block_2 = CodeBlock { 0..50..5; }
translate = Geometry.Translate(geometry=byPatch, zTranslation=code_block_2, lacing=CrossProduct)

# group: #644749
integer_slider = IntegerSlider(100, range=0..100 step 1)
integer_slider_2 = IntegerSlider(71, range=0..100 step 1)
integer_slider_3 = IntegerSlider(73, range=0..100 step 1)
byARGB = Color.ByARGB(r=integer_slider, g=integer_slider_2, b=integer_slider_3)

# group: #b1695a
integer_slider_4 = IntegerSlider(177, range=0..300 step 1)
integer_slider_5 = IntegerSlider(105, range=0..300 step 1)
integer_slider_6 = IntegerSlider(90, range=0..300 step 1)
byARGB_2 = Color.ByARGB(r=integer_slider_4, g=integer_slider_5, b=integer_slider_6)

code_block_3 = CodeBlock { 227; }
code_block_4 = CodeBlock { 187; }
code_block_5 = CodeBlock { 136; }
byARGB_3 = Color.ByARGB(r=code_block_3, g=code_block_4, b=code_block_5)

# group: #db9864
integer_slider_7 = IntegerSlider(219, range=0..300 step 1)
integer_slider_8 = IntegerSlider(152, range=0..300 step 1)
integer_slider_9 = IntegerSlider(100, range=0..300 step 1)
byARGB_4 = Color.ByARGB(r=integer_slider_7, g=integer_slider_8, b=integer_slider_9)

# group: #8ba892
code_block_6 = CodeBlock { 139; }
code_block_7 = CodeBlock { 168; }
code_block_8 = CodeBlock { 146; }
byARGB_5 = Color.ByARGB(r=code_block_6, g=code_block_7, b=code_block_8)

# group: #617d67
code_block_9 = CodeBlock { 97; }
code_block_10 = CodeBlock { 125; }
code_block_11 = CodeBlock { 103; }
byARGB_6 = Color.ByARGB(r=code_block_9, g=code_block_10, b=code_block_11)

list_create = List.Create(item0=byARGB, item1=byARGB_2, item2=byARGB_3, item3=byARGB_4, item4=byARGB_5, item5=byARGB_6)
code_block_12 = CodeBlock { 0; 0.2; 0.4; 0.75; 0.9; 1; }
list_create_2 = List.Create(item0=code_block_12.out0, item1=code_block_12.out1, item2=code_block_12.out2, item3=code_block_12.out3, item4=code_block_12.out4, item5=code_block_12.out5)
count = List.Count(list=byCenterPointRadius, lacing=Shortest)
code_block_13 = CodeBlock(a=count) { a; 0..#a..1; }
code_block_14 = CodeBlock(a=code_block_13.a) { 0; a; }
code_block_15 = CodeBlock { 0; 1; }
mapTo = Math.MapTo(rangeMin=code_block_14.out0, rangeMax=code_block_14.a, inputValue=code_block_13.out1, targetRangeMin=code_block_15.out0, targetRangeMax=code_block_15.out1)
color_range = ColorRange(colors=list_create, indices=list_create_2, value=mapTo)
bySurfaceColors = Modifiers.GeometryColor.BySurfaceColors(surface=translate, colors=color_range)
