# Dynamo graph ID号提取写入.dyn (Dynamo 1.2.2.373)

join = List.Join()  # unwired: arg0, arg1

# group: 框选多个图元,获取名称
select_model_elements = DSModelElementsSelection()  # 369 picked in the model

name = Element.Name(select_model_elements)

# group (continued): 框选多个图元,获取名称
join_2 = List.Join(name)

# group: 框选多个图元，获取ID
select_model_elements_2 = DSModelElementsSelection()  # 369 picked in the model
id = Element.Id(select_model_elements_2)
join_3 = List.Join(id)

combine = List.Combine(join, join_2, join_3)

# group: 写入excel
file_path = Filename(".\ID%E5%8F%B7%E5%86%99%E5%85%A5.xlsx")
code_block = CodeBlock { "Sheet1"; }
code_block_2 = CodeBlock { 0; }
boolean = BoolSelector(true)
writeToFile = Excel.WriteToFile(filePath=file_path, sheetName=code_block, startRow=code_block_2, startCol=code_block_2, data=combine, overWrite=boolean)
