# Dynamo graph ID提取.dyn (Dynamo 1.2.2.373)

# group: 框选多个图元,获取名称
select_model_elements = DSModelElementsSelection()  # 369 picked in the model

name = Element.Name(select_model_elements)

# group (continued): 框选多个图元,获取名称
join = List.Join(name)

# group: 框选多个图元，获取ID
select_model_elements_2 = DSModelElementsSelection()  # 369 picked in the model
id = Element.Id(select_model_elements_2)
join_2 = List.Join(id)

# group: 生成对应列表
join_3 = List.Join()  # unwired: arg0, arg1
combine = List.Combine(join_3, join, join_2)

# group: 写入excel
file_path = Filename(".\ID%E5%8F%B7%E5%86%99%E5%85%A5.xlsx")
code_block = CodeBlock { "Sheet1"; }
code_block_2 = CodeBlock { 0; }
boolean = BoolSelector(true)
writeToFile = Excel.WriteToFile(filePath=file_path, sheetName=code_block, startRow=code_block_2, startCol=code_block_2, data=combine, overWrite=boolean)  # frozen

# group: 框选构件提取id号和名称
select_model_elements_3 = DSModelElementsSelection()  # 369 picked in the model
name_2 = Element.Name(select_model_elements_3)
select_model_elements_4 = DSModelElementsSelection()  # 369 picked in the model
id_2 = Element.Id(select_model_elements_4)
code_block_3 = CodeBlock(List1=name_2, list2=id_2) { List1; list2; }

# group: 生成对应列表
join_4 = List.Join()  # unwired: arg0, arg1
combine_2 = List.Combine(join_4, code_block_3.List1, code_block_3.list2)

# group: 写入excel
file_path_2 = Filename(".\ID%E5%8F%B7%E5%86%99%E5%85%A52.xlsx")
code_block_4 = CodeBlock { "Sheet2"; }
code_block_5 = CodeBlock { 0; }
boolean_2 = BoolSelector(true)
writeToFile_2 = Excel.WriteToFile(filePath=file_path_2, sheetName=code_block_4, startRow=code_block_5, startCol=code_block_5, data=combine_2, overWrite=boolean_2)
