# Dynamo graph 旋转楼彩色渐变.dyn (Dynamo 2.1.0.7500)

# group: 玻璃幕墙项目中选取
select_model_element = DSModelElementSelection()  # 1 picked in the model
byElement = CurtainPanel.ByElement(hostingElement=select_model_element)

# group: 生成颜色数据
color_palette = ColorPalette({R: 148, G: 0, B: 211, A: 255})
color_palette_2 = ColorPalette({R: 255, G: 127, B: 80, A: 255})
list_create = List.Create(item0=color_palette, item1=color_palette_2)
code_block = CodeBlock { [0,1]; }
code_block_2 = CodeBlock { 2000; }
sequence = Sequence(amount=code_block_2)
maximumItem = List.MaximumItem(list=sequence)
div = sequence / maximumItem
color_range = ColorRange(colors=list_create, indices=code_block, value=div)

overrideColorInView = Element.OverrideColorInView(element=byElement, color=color_range)
